# Grasshopper definition String Passthrough Test Script.ghx (Grasshopper 1.0.8)
# plug-ins: Pufferfish, Firefly.X, Firefly.Core

com_port = Slider(3, range=0..10)

# ---- group: Color Gradient
range = Range(Domain=Domain(0, 1), Steps=Slider(7, range=0..10))
twn2cols = TweenTwoColors(
    ColorA=ColourSwatch(SwatchColor=RGB(246, 31, 0)),
    ColorB=ColourSwatch(SwatchColor=RGB(53, 169, 97)),
    Factor=range,
    Alpha=True)

# ----
argb = SplitARGB(Colour=graft(twn2cols))  # -> Alpha, Red, Green, Blue
ports_available = COMPortsAvailable()
open_port = OpenClosePort(OpenClosePort=Toggle(True), PortNumber=ports_available, BaudRate="115200")
repeat = RepeatData()
osc_sender = OSCSender(IPAddressOfUDPServer="127.0.0.1", UDPPort=8001)
panel = Panel("""Hello
World!
Testing
Even with a long sencetence
a
345
245,23,54
this next one is blank

that last one was blank""")
udp_sender = UDPSender(IPAddressOfUDPServer="127.0.0.1", UDPPort=8000)
join = TextJoin(Join=" ")

# ---- group: Stepper
trigger = Trigger(Interval=1000, TimerInterval=1000, Target=num)
num = Number(Slider(1, range=0..1))
rec = DataRecorder(num, DataLimit=-10, RecordData=True)
number_slider = Slider(8, range=0..10)
ma = MassAddition(Input=rec)  # -> Result, PartialResults
mod = Modulus(A=ma.Result, B=number_slider)

# ----
integer_division = IntegerDivision(A=ma.Result, B=number_slider)

# ---- group: Stepper (continued)
mod_2 = Modulus(A=integer_division, B=number_slider)

# ----
merge = Merge(Data1=mod_2, Data2=argb.Red, Data3=argb.Green, Data4=argb.Blue)
item = ListItem(List=panel, Index=mod, Wrap=True)
write = SerialWriteGeneric(StartWritingValues=Toggle(False), WriteData=item, PortNumber=com_port)  # -> ArduinoOutput, StatusMessage
panel_2 = Panel(item)
